# Dynamo graph Determine Panel dimensions Rev.00 - withOutElement ID-newest.dyn (Dynamo 3.3.0.6316)
# packages: DynamoUnfold 1.0.1

# group: ModelCurve To Revit
byCurve = ModelCurve.ByCurve()  # unwired: curve

code_block = CodeBlock { 0; }
categories = Categories("OST_CurtainWallPanels")  # graph input
all_elements_of_category = ElementsOfCategory(Category=categories)
watch = Watch(all_elements_of_category)
geometry = Element.Geometry(element=watch)
code_block_2 = CodeBlock { 1; }
select_desire_panels_to_be = CodeBlock { 4; }  # "Select Desire Panels to be unfold"
getItemAtIndex = List.GetItemAtIndex(index=select_desire_panels_to_be)  # unwired: list

# group: Unfold
faces = Topology.Faces(topology=geometry)
boolean = BoolSelector(false)  # graph input
clean = List.Clean(list=faces, preserveIndices=boolean)
select_desire_panels_to_be_2 = CodeBlock { 0; }  # "Select Desire Panels to be unfold"
getItemAtIndex_2 = List.GetItemAtIndex(index=select_desire_panels_to_be_2)  # unwired: list
map = List.Map(list=clean, function=getItemAtIndex_2)
# note: DynamoUnfold
map_2 = List.Map(list=map, function=getItemAtIndex)
identity = CoordinateSystem.Identity()
XAxis = Vector.XAxis()
distance_between_each_panels = DoubleSlider(2500, range=0..2500 step 0.1)  # graph input
labels_size = CodeBlock { 75; }

count = List.Count(list=map)
sub = count - code_block_2
range = Range(start=code_block, end=sub, step=code_block_2)
surfaceGeometry = Face.SurfaceGeometry(face=map_2)

# group (continued): Unfold
coordinateSystemAtParameter = Surface.CoordinateSystemAtParameter(surface=surfaceGeometry)
transform = Geometry.Transform(geometry=surfaceGeometry, fromCoordinateSystem=coordinateSystemAtParameter, contextCoordinateSystem=identity)
count_2 = List.Count(list=transform)
code_block_3 = CodeBlock(itemsTobeTranslate=count_2, Distance=distance_between_each_panels) { 5000..#itemsTobeTranslate..Distance; }
translate = Geometry.Translate(geometry=transform, direction=XAxis, distance=code_block_3)
unfoldListOfSurfaces_AndReturnTransforms = DynamoUnfold.Unfolding.UnfoldListOfSurfaces_AndReturnTransforms(surfaces=translate)
generateUnfoldedLabels = DynamoUnfold.Unfolding.GenerateUnfoldedLabels(unfoldingObject=unfoldListOfSurfaces_AndReturnTransforms.unfoldingObject, labelScale=labels_size)
unfoldListOfSurfaces_AndReturnTransforms_2 = DynamoUnfold.Unfolding.UnfoldListOfSurfaces_AndReturnTransforms(surfaces=surfaceGeometry)
generateInitialLabels = DynamoUnfold.Unfolding.GenerateInitialLabels(unfoldingObject=unfoldListOfSurfaces_AndReturnTransforms_2.unfoldingObject, labelScale=labels_size)
flatten = List.Flatten(list=generateInitialLabels)

# group: Curves to ModelLine
perimeterCurves = Surface.PerimeterCurves(surface=translate)

byJoinedCurves = PolyCurve.ByJoinedCurves(curves=perimeterCurves)
curves = PolyCurve.Curves(polyCurve=byJoinedCurves)

# group: Length
length = Curve.Length(curve=curves)
watch_2 = Watch(length)
code_block_4 = CodeBlock { 2; }
flatten_2 = List.Flatten(list=watch_2, amount=code_block_4)

# group: Items
count_3 = List.Count()  # unwired: list
map_3 = List.Map(list=watch_2, function=count_3)
ofRepeatedItem = List.OfRepeatedItem(item=range, amount=map_3, lacing=Longest)
flatten_3 = List.Flatten(list=ofRepeatedItem)
watch_3 = Watch(flatten_3)

# group: Description
string_from_object = FromObject()  # unwired: object
count_4 = List.Count()  # unwired: list
map_4 = List.Map(list=watch_2, function=count_4)
ofRepeatedItem_2 = List.OfRepeatedItem(item=string_from_object, amount=map_4, lacing=Longest)
code_block_5 = CodeBlock { 2; }
flatten_4 = List.Flatten(list=ofRepeatedItem_2, amount=code_block_5)

length_2 = Curve.Length(curve=byJoinedCurves)

# group: Location
watch_4 = Watch()  # unwired: arg0
string_from_object_2 = FromObject(object=watch_4)
code_block_6 = CodeBlock { 0; 6; }
remove = String.Remove(string=string_from_object_2, startIndex=code_block_6.out0, count=code_block_6.out1)
string_from_object_3 = FromObject(object=remove)
length_3 = String.Length(string=string_from_object_3)
code_block_7 = CodeBlock(x=length_3) { x-1; }
substring = String.Substring(string=remove, startIndex=code_block_6.out0, length=code_block_7)
flatten_5 = List.Flatten(list=substring)
watch_5 = Watch(flatten_5)

getItemAtIndex_3 = List.GetItemAtIndex(list=watch, index=range)

# group: Mark
count_5 = List.Count()  # unwired: list
map_5 = List.Map(list=watch_2, function=count_5)
ofRepeatedItem_3 = List.OfRepeatedItem(item=getItemAtIndex_3, amount=map_5, lacing=Longest)
flatten_6 = List.Flatten(list=ofRepeatedItem_3)
code_block_8 = CodeBlock { ["Mark"]; }
getParameterValueByName = Element.GetParameterValueByName(element=flatten_6, parameterName=code_block_8, lacing=CrossProduct)
flatten_7 = List.Flatten(list=getParameterValueByName)

# group: Total Length
code_block_9 = CodeBlock { ""; }
code_block_10 = CodeBlock(x=map_5) { x-1; }
ofRepeatedItem_4 = List.OfRepeatedItem(item=code_block_9, amount=code_block_10, lacing=Longest)
code_block_11 = CodeBlock { 1; }
flatten_8 = List.Flatten(list=ofRepeatedItem_4, amount=code_block_11)
addItemToEnd = List.AddItemToEnd(item=length_2, list=flatten_8, lacing=Longest)
flatten_9 = List.Flatten(list=addItemToEnd)

# group: Surface.Area
area = Surface.Area(surface=surfaceGeometry)
code_block_12 = CodeBlock(x=area) { x/1000000; }
code_block_13 = CodeBlock { ""; }
code_block_14 = CodeBlock(x=map_5) { x-1; }
ofRepeatedItem_5 = List.OfRepeatedItem(item=code_block_13, amount=code_block_14, lacing=Longest)
code_block_15 = CodeBlock { 1; }
flatten_10 = List.Flatten(list=ofRepeatedItem_5, amount=code_block_15)
addItemToEnd_2 = List.AddItemToEnd(item=code_block_12, list=flatten_10, lacing=Longest)
flatten_11 = List.Flatten(list=addItemToEnd_2)

# group: To Excel
string = StringInput("E:\Backup\Dynamo\.My Activity\Determine Panel dimensions\Curtain_Schedule.xlsx")  # graph input
code_block_16 = CodeBlock { "Sheet1"; 1; 0; }
exportExcel = Data.ExportExcel(filePath=string, sheetName=code_block_16.out0, startRow=code_block_16.out1, startColumn=code_block_16.out2)  # unwired: data
create = List.Create(item0=watch_3, item1=flatten_4, item2=flatten_2, item3=flatten_9, item4=flatten_11, item5=watch_5, item6=flatten_7)
transpose = List.Transpose(lists=create)

# group: 3D Annotation on Base Surface
code_block_17 = CodeBlock()
# ---------- code_block_17.designscript (2 lines) ----------
["3DName","On Plan view",
"On Elevation","TextSize"];
# ----------------------------------------
setParameterByName = Element.SetParameterByName(parameterName=code_block_17)  # unwired: element, value
family_types = FamilyTypes("3DName:3DName")  # graph input
code_block_18 = CodeBlock { 0.5; }
pointAtParameter = Surface.PointAtParameter(surface=surfaceGeometry, u=code_block_18, v=code_block_18)
byPoint = FamilyInstance.ByPoint(familyType=family_types, point=pointAtParameter)
string_from_object_4 = FromObject(object=range)
code_block_19 = CodeBlock { 0; 1; 50; }
count_6 = List.Count(list=byPoint)
ofRepeatedItem_6 = List.OfRepeatedItem(item=code_block_19.out0, amount=count_6)
ofRepeatedItem_7 = List.OfRepeatedItem(item=code_block_19.out1, amount=count_6)
ofRepeatedItem_8 = List.OfRepeatedItem(item=code_block_19.out2, amount=count_6)
code_block_20 = CodeBlock(a=string_from_object_4, b=ofRepeatedItem_6, c=ofRepeatedItem_7, d=ofRepeatedItem_8) { [a,b,c,d]; }
transpose_2 = List.Transpose(lists=code_block_20)
combine = List.Combine(combineFunction=setParameterByName, list0=byPoint, list1=transpose_2)

flatten_12 = List.Flatten(list=combine)
code_block_21 = CodeBlock(num=flatten_12)
# ---------- code_block_21.designscript (11 lines) ----------
r=Color.ByARGB(255,255,0,0);
o=Color.ByARGB(255,255,128,0);
y=Color.ByARGB(255,255,255,0);
g=Color.ByARGB(255,0,255,0);
b=Color.ByARGB(255,0,128,255);
i=Color.ByARGB(255,0,0,255);
v=Color.ByARGB(255,127,0,255);
colors=[r,o,y,g,b,i,v];
0..1..#7;
a=List.Count(num);
0..1..#a;
# ----------------------------------------
color_range = ColorRange(colors=code_block_21.colors, indices=code_block_21.out8, value=code_block_21.out10)

# group: 3D Annotation
overrideColorInView = Element.OverrideColorInView(color=color_range)  # unwired: element

# group: 3D Annotation
overrideColorInView_2 = Element.OverrideColorInView(color=color_range)  # unwired: element

# group: 3D Annotation on Unfolded Surface
code_block_22 = CodeBlock()  # same code as code_block_17
setParameterByName_2 = Element.SetParameterByName(parameterName=code_block_22)  # unwired: element, value
family_types_2 = FamilyTypes("3DName:3DName")  # graph input
code_block_23 = CodeBlock { 0.5; }
pointAtParameter_2 = Surface.PointAtParameter(surface=translate, u=code_block_23, v=code_block_23)
byPoint_2 = FamilyInstance.ByPoint(familyType=family_types_2, point=pointAtParameter_2)
string_from_object_5 = FromObject(object=range)
code_block_24 = CodeBlock { 1; 0; 50; }
count_7 = List.Count(list=byPoint_2)
ofRepeatedItem_9 = List.OfRepeatedItem(item=code_block_24.out0, amount=count_7)
ofRepeatedItem_10 = List.OfRepeatedItem(item=code_block_24.out1, amount=count_7)
ofRepeatedItem_11 = List.OfRepeatedItem(item=code_block_24.out2, amount=count_7)
code_block_25 = CodeBlock(a=string_from_object_5, b=ofRepeatedItem_9, c=ofRepeatedItem_10, d=ofRepeatedItem_11) { [a,b,c,d]; }
transpose_3 = List.Transpose(lists=code_block_25)
combine_2 = List.Combine(combineFunction=setParameterByName_2, list0=byPoint_2, list1=transpose_3)

flatten_13 = List.Flatten(list=combine_2)

# group: Labels on Unflod Surface
byCurve_2 = ModelCurve.ByCurve()  # unwired: curve

flatten_14 = List.Flatten(list=generateUnfoldedLabels)

# group: Labels on Base Surface
byCurve_3 = ModelCurve.ByCurve()  # unwired: curve

# group: Select Curtain Panels
select_model_elements = DSModelElementsSelection()  # 46 picked in the model; graph input
watch_6 = Watch(select_model_elements)
flatten_15 = List.Flatten(list=watch_6)
string_from_object_6 = FromObject()  # unwired: object
code_block_26 = CodeBlock(a=watch_6) { a[1]; }
string_from_object_7 = FromObject(object=code_block_26)
boolean_2 = BoolSelector(false)  # graph input
contains = String.Contains(searchFor=string_from_object_7, ignoreCase=boolean_2)  # unwired: string
compose = ComposeFunctions(function0=string_from_object_6, function1=contains)  # "Function.Compose"
filter = List.Filter(list=flatten_15, condition=compose)
match = Watch(filter.in)
